# Grasshopper definition NODEMaple Grasshopper.gh (Grasshopper 1.0.9)

nodemaple_materials = Python3Script()  # -> materials, debug
# ---------- nodemaple_materials: Python ----------
"""
NODEMaple Materials — Level 1
Queries the list of available materials from the NODE Maple library.

Requires:
  - Maple installed locally (default: Maple 2026)
  - NODE Library packages installed via PackageTools

Output:
  materials : list of material names, e.g. ["steel", "timber", "concrete"]
  debug     : raw Maple output for troubleshooting
"""
import os
import subprocess

# ---------------------------------------------------------------------------
# Configuration
# ---------------------------------------------------------------------------
# Maple version, overridable via GH input or the MAPLE environment variable.
# The environment variable takes precedence since it points to a concrete
# installation (e.g. "C:\Program Files\Maple 2026").
if os.environ.get("MAPLE"):
    MAPLE_ROOT = os.environ["MAPLE"]
else:
    MAPLE_ROOT = os.path.join(r"C:\Program Files", f"Maple {maple_version}")

MAPLE_EXE = os.path.join(MAPLE_ROOT, "bin.X86_64_WINDOWS", "cmaple.exe")


def run_maple_script(script, timeout=20):
    """Run a Maple script in a fresh cmaple process and return its output.

    Starts cmaple in quiet mode (-q), feeds the script via stdin and
    collects everything written to stdout/stderr. Failures surface in
    the returned text rather than crashing Rhino.
    """
    env = dict(os.environ)
    env["MAPLE"] = MAPLE_ROOT
    # Ensure Maple's binaries are found from the subprocess on any host.
    env["PATH"] = os.path.join(MAPLE_ROOT, "bin.X86_64_WINDOWS") + \
        os.pathsep + env.get("PATH", "")

    proc = subprocess.Popen(
        [MAPLE_EXE, "-q"],
        stdin=subprocess.PIPE,
        stdout=subprocess.PIPE,
        stderr=subprocess.STDOUT,
        text=True,
        cwd=os.path.join(MAPLE_ROOT, "bin.X86_64_WINDOWS"),
        env=env,
        creationflags=subprocess.CREATE_NO_WINDOW)

    out, _ = proc.communicate(input=script, timeout=timeout)
    return out


def get_material_list():
    """Query NODEFunctions:-Materials() and return the parseable script.

    NODE modules are auto-loaded from the user's Maple toolbox
    (installed via PackageTools), so no with() call is required.
    """
    script = (
        "kernelopts(printbytes=false):\n"
        "interface(prettyprint=0):\n"
        "matlist := NODEFunctions:-Materials():\n"
        "for m in matlist do\n"
        '    printf("MAT|%s\\n", m)\n'
        "end do:\n"
        "quit:\n"
    )
    return run_maple_script(script)


# ---------------------------------------------------------------------------
# Main execution
# ---------------------------------------------------------------------------
raw = get_material_list()

materials = []
for line in raw.splitlines():
    s = line.strip()
    if s.startswith("MAT|"):
        name = s.split("|", 1)[1].strip().strip('"')
        if name:
            materials.append(name)

debug = raw  # full Maple output for troubleshooting
# ---------- end nodemaple_materials ----------
panel = Panel(nodemaple_materials.materials)
panel_2 = Panel(nodemaple_materials.debug)
timber_properties = Python3Script(material="C24", prop="f_m,k")  # -> out, value, unit, debug
# ---------- timber_properties: Python ----------
"""NODE-Timber-Materialabfrage, parametrisiert"""
import os, subprocess

MAPLE_PATH = r"C:\Program Files\Maple 2026\bin.X86_64_WINDOWS\cmaple.exe"
MAPLE_ROOT = r"C:\Program Files\Maple 2026"

def timber_property(material, prop):
    maple_dir = os.path.dirname(MAPLE_PATH)
    env = dict(os.environ)
    env["PATH"] = maple_dir + os.pathsep + env.get("PATH", "")
    env["MAPLE"] = MAPLE_ROOT

    script = (
        'with(NODETimberMaterial):\n'
        'kernelopts(printbytes=false):\n'
        'interface(prettyprint=0):\n'
        f'p := Property("{material}", "{prop}"):\n'
        'q := Units:-Split(p):\n'
        'printf("VALUE=%a\\n", evalf(q[1])):\n'
        'printf("UNIT=%a\\n", q[2]):\n'
        'quit:\n'
    )

    proc = subprocess.Popen(
        [MAPLE_PATH, "-q"],
        stdin=subprocess.PIPE, stdout=subprocess.PIPE,
        stderr=subprocess.STDOUT, text=True,
        cwd=maple_dir, env=env,
        creationflags=subprocess.CREATE_NO_WINDOW)

    out, _ = proc.communicate(input=script, timeout=20)
    return out

# ---- Eingaben ----
raw = timber_property(material, prop)

value = None
unit  = None
parsed = []                      # Diagnose: was wurde erkannt?

for line in raw.splitlines():
    s = line.strip()
    parsed.append(repr(s))        # Zeile 1:1 mit Sonderzeichen sichtbar
    if s.startswith("VALUE="):
        try:
            value = float(s.split("=", 1)[1])
            parsed.append(f"  -> value = {value!r}")
        except ValueError as e:
            parsed.append(f"  !! float-Fehler: {e}")
    elif s.startswith("UNIT="):
        unit = s.split("=", 1)[1]
        parsed.append(f"  -> unit = {unit!r}")

debug = "\n".join(parsed)
# ---------- end timber_properties ----------
panel_3 = Panel(timber_properties.unit)
panel_4 = Panel(timber_properties.out)
panel_5 = Panel(timber_properties.value)
panel_6 = Panel(timber_properties.debug)
